# Grasshopper definition 00_main.gh (Grasshopper 1.0.7)

# ----
# Overall bounding box
# Edge size [m]
panel = Panel("10")

# ----
# Analysis: 1m³ boxes within boundary box
# Edge size [m]
panel_2 = Panel("1")

# ----
# Joint size
# (radius)
panel_3 = Panel("3.51965451271369")

# ----
# Joint Set 2
# Dip
panel_4 = Panel("37")

# ----
# Joint size
# (radius)
panel_5 = Panel("7.10712145397136")

# ----
# Joint size
# (radius)
panel_6 = Panel("4.25997227917307")

# ----
# DipDir
panel_7 = Panel("351")

# ----
# DipDir
panel_8 = Panel("111")

# ----
# Random Seed setting
panel_9 = Panel("78")

# ----
# Joint Set 1
# Dip
panel_10 = Panel("50")

# ----
# DipDir
panel_11 = Panel("169")

# ----
# Joint Set 3
# Dip
panel_12 = Panel("64")

# ----
# Random Set
# N joints
panel_13 = Panel("10")

# ----
# Joint size
# (radius)
panel_14 = Panel("2.48112470764302")

# ----
# Identifier
panel_15 = Panel("0000")

# ----
# Dipdir std
panel_16 = Panel("39")

# ----
# Joint size
# std
panel_17 = Panel("1.30326634522966")

# ----
# Dipdir std
panel_18 = Panel("8")

# ----
# Dip std
panel_19 = Panel("9")

# ----
# Dipdir std
panel_20 = Panel("13")

# ----
# Joint size
# std
panel_21 = Panel("1.44777281722102")

# ----
# Joint size
# std
panel_22 = Panel("0.642488613103591")

# ----
# Joint size
# std
panel_23 = Panel("0.288161170286212")

# ----
# Dip std
panel_24 = Panel("16")

# ----
# N joints
panel_25 = Panel("10")

# ----
# N joints
panel_26 = Panel("10")

# ----
# Dip std
panel_27 = Panel("5")

# ----
# N joints
panel_28 = Panel("10")

# ----
# Single run of main cluster with custom parameters
cluster = Cluster(
    num=panel,
    num_3=panel_2,
    S=panel_9,
    n_discontinuities=panel_25,
    size_radius_2=panel_3,
    size_std=panel_17,
    dip_direction=panel_8,
    dipdir_std=panel_16,
    dip=panel_10,
    dip_std_2=panel_19,
    n_discontinuities_2=panel_28,
    size_radius_3=panel_5,
    size_std_3=panel_21,
    dip_direction_2=panel_7,
    dipdir_std_2=panel_18,
    dip_2=panel_4,
    dip_std_3=panel_24,
    n_discontinuities_4=panel_26,
    size_radius_4=panel_6,
    size_std_4=panel_23,
    dip_direction_3=panel_11,
    dipdir_std_3=panel_20,
    dip_3=panel_12,
    dip_std=panel_27,
    n_discontinuities_3=panel_13,
    size_radius=panel_14,
    size_std_2=panel_22,
    identifier=panel_15)  # -> spacing_set_1, spacing_set_2, spacing_set_3, rqd_y, rqd_x, rqd_z, apparent_spacing_y, apparent_spacing_x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; disabled

# ----
# Run the cluster several times
# [m]
# [m]
# [m]
toggle = BooleanToggle(False)
trigger = GetBoolean(toggle, AtLeast=1, AtMost=1, FalseValue="False", TreeAccess=False, TrueValue="True")
bbox_size = GetInteger("10", AtLeast=1, AtMost=1, Maximum=2147483647, Minimum=-2147483648, TreeAccess=False)
max_n_joints = GetInteger("400", AtLeast=1, AtMost=1, Maximum=2147483647, Minimum=-2147483648, TreeAccess=False)
jv_edge_size = GetInteger("1", AtLeast=1, AtMost=1, Maximum=2147483647, Minimum=-2147483648, TreeAccess=False)
max_joint_size = GetInteger("8", AtLeast=1, AtMost=1, Maximum=2147483647, Minimum=-2147483648, TreeAccess=False)
n_simulations = GetInteger("21", AtLeast=1, AtMost=1, Maximum=2147483647, Minimum=-2147483648, TreeAccess=False)
python = GhPythonScript(
    trigger=trigger,
    BBOX_SIZE=bbox_size,
    JV_EDGE_SIZE=jv_edge_size,
    MAX_N_JOINTS=max_n_joints,
    MAX_JOINT_SIZE=max_joint_size,
    n_simulations=n_simulations)  # -> out; inputs BBOX_SIZE: Int32, JV_EDGE_SIZE: Int32, MAX_N_JOINTS: Int32, MAX_JOINT_SIZE: Int32, n_simulations: Int32
# ---------- python: Python ----------
from math import fabs, atan2, sin, cos, radians, degrees
from random import randint, uniform
import Grasshopper as gh


def mean(list_):
    ''' computes arithmetic mean '''
    return sum(list_)/len(list_)

def angle_difference(dip1, dip2, dipdir1, dipdir2):
    ''' function that checks how close 2 orientations are to each other '''
    diff_dip = fabs(dip1-dip2)
    diff_dipdir = fabs(degrees(atan2(sin(radians(dipdir1) - radians(dipdir2)), cos(radians(dipdir1) - radians(dipdir2)))))
    if diff_dip <= 10 or diff_dipdir <= 45:
        # if too close
        check = False
    else:
        # if difference large enough
        check =True
    return check

def make_angles(dips, dipdirs):
    ''' make new orientations and check if they are sufficiently dissimilar than existing ones '''
    check = False
    while check is False:
        new_dip = randint(0, 90)
        new_dipdir = randint(0, 360)
        checks = []
        for dip, dipdir in zip(dips, dipdirs):
            checks.append(angle_difference(new_dip, dip, new_dipdir, dipdir))
        if False in checks:
            check = False
        else:
            check = True
    return new_dip, new_dipdir


if trigger is True:
    cluster = gh.Kernel.Special.GH_Cluster()
    cluster_path = r'C:\Users\GEr\OneDrive - NGI\Research\Parametric_Rockmass_Studies\src\00_Cluster.ghcluster'
    cluster.CreateFromFilePath(cluster_path)
    results_path = r'C:\Users\GEr\OneDrive - NGI\Research\Parametric_Rockmass_Studies\combinations'

    for _ in range(int(n_simulations)):
        idx = randint(100000000000, 999999999999)
        seed = randint(1, 100)

        S1_n_joints = randint(0, MAX_N_JOINTS)
        S1_joint_size = uniform(0.25, MAX_JOINT_SIZE)
        S1_joint_size_std = uniform(0, S1_joint_size*0.5)
        S1_dipdir = randint(0, 360)
        S1_dipdir_std = randint(0, 40)       
        S1_dip = randint(0, 90)
        S1_dip_std = randint(0, 20)

        S2_n_joints = randint(0, MAX_N_JOINTS)
        S2_joint_size = uniform(0.25, MAX_JOINT_SIZE)
        S2_joint_size_std = uniform(0, S2_joint_size*0.5)
        S2_dip, S2_dipdir = make_angles([S1_dip], [S1_dipdir])
        S2_dipdir_std = randint(0, 40)
        S2_dip_std = randint(0, 20)

        S3_n_joints = randint(0, MAX_N_JOINTS)
        S3_joint_size = uniform(0.25, MAX_JOINT_SIZE)
        S3_joint_size_std = uniform(0, S3_joint_size*0.5)
        S3_dip, S3_dipdir = make_angles([S1_dip, S2_dip], [S1_dipdir, S2_dipdir])
        S3_dipdir_std = randint(0, 40)
        S3_dip_std = randint(0, 20)

        RandS_n_joints = randint(0, MAX_N_JOINTS)
        RandS_joint_size = mean([S1_joint_size, S2_joint_size, S3_joint_size])/2
        RandS_joint_size_std = uniform(0, RandS_joint_size*0.5)

        if S1_n_joints + S2_n_joints + S3_n_joints == 0:
            # check if combination has 0 discontinuiites
            pass
        else:
            # input definition
            inputs = (BBOX_SIZE, JV_EDGE_SIZE, seed,
                      S1_n_joints, S1_joint_size, S1_joint_size_std, S1_dipdir, S1_dipdir_std, S1_dip, S1_dip_std,
                      S2_n_joints, S2_joint_size, S2_joint_size_std, S2_dipdir, S2_dipdir_std, S2_dip, S2_dip_std,
                      S3_n_joints, S3_joint_size, S3_joint_size_std, S3_dipdir, S3_dipdir_std, S3_dip, S3_dip_std,
                      RandS_n_joints, RandS_joint_size, RandS_joint_size_std, idx)
            for i, param in enumerate(inputs):
                cluster.Params.Input[i].AddVolatileData(gh.Kernel.Data.GH_Path(0), 0, param)

            # weird grasshopper document initialization
            doc = gh.Kernel.GH_Document()
            doc.Enabled = True
            doc.AddObject(cluster, True, 0)
            # get outputs
            outputs = []
            for j in range(len(cluster.Params.Output)):
                structure = cluster.Params.Output[j].VolatileData
                tree = gh.DataTree[object]()
                tree.MergeStructure(structure, gh.Kernel.Parameters.Hints.GH_NullHint())
                if len(tree.AllData()) > 0:
                    outputs.append(tree.AllData()[0])
                else:
                    f = open('{}\{}.txt'.format(results_path, 'FAIL'), 'w')
                    f.write(str(inputs))
                    f.close()
                    outputs.append(tree.AllData()[0])

            # construct result string
            result_str = str(inputs)
            for output in outputs:
                out_str = str(output)
                result_str += ',{}'.format(out_str)
            # write to file
            f = open('{}\{}.txt'.format(results_path, idx), 'w')
            f.write(result_str)
            f.close()

            # weird grasshopper document closing
            doc.Enabled = False
            doc.RemoveObject(cluster, False)
            doc.Dispose()
            doc = None
# ---------- end python ----------
panel_29 = Panel(python)

# ----
# P20 X
panel_30 = Panel(cluster.p20_x)

# ----
# P21 X
panel_31 = Panel(cluster.p21_x)

# ----
# Number of blocks
panel_32 = Panel(cluster.blocks_n)

# ----
# P10 Y
panel_33 = Panel(cluster.p10_y)

# ----
# RQD Y
panel_34 = Panel(cluster.rqd_y)

# ----
# P32
panel_35 = Panel(cluster.p32)

# ----
# apparent spacing
# parallel Y [m]
panel_36 = Panel(cluster.apparent_spacing_y)

# ----
# measured spacing
# disc. set 1 [m]
panel_37 = Panel(cluster.spacing_set_1)

# ----
# P30 measured Jv
# [joints / m³]
panel_38 = Panel(cluster.measured_jv)

# ----
# P20 Y
panel_39 = Panel(cluster.p20_y)

# ----
# P21 Y
panel_40 = Panel(cluster.p21_y)

# ----
# P10 X
panel_41 = Panel(cluster.p10_x)

# ----
# RQD X
panel_42 = Panel(cluster.rqd_x)

# ----
# Max block
# volume
panel_43 = Panel(cluster.blocks_max_volume)

# ----
# P20 Z
panel_44 = Panel(cluster.p20_z)

# ----
# P21 Z
panel_45 = Panel(cluster.p21_z)

# ----
# P10 Z
panel_46 = Panel(cluster.p10_z)

# ----
# apparent spacing
# parallel X [m]
panel_47 = Panel(cluster.apparent_spacing_x)

# ----
# RQD Z
panel_48 = Panel(cluster.rqd_z)

# ----
# measured spacing
# disc. set 2 [m]
panel_49 = Panel(cluster.spacing_set_2)

# ----
# Min block
# volume
panel_50 = Panel(cluster.blocks_min_volume)

# ----
# Avg. block
# volume
panel_51 = Panel(cluster.blocks_avg_volume)

# ----
# apparent spacing
# parallel Z [m]
panel_52 = Panel(cluster.apparent_spacing_z)

# ----
# measured spacing
# disc. set 3 [m]
panel_53 = Panel(cluster.spacing_set_3)

# ----
# Avg. block
# edge length
panel_54 = Panel(cluster.blocks_avg_edge_length)

# ----
# Avg. block
# surface area
panel_55 = Panel(cluster.blocks_avg_area)

# ----
# Avg. block
# long dimension
panel_56 = Panel(cluster.a3)

# ----
# Avg. block
# middle dimension
panel_57 = Panel(cluster.a2)

# ----
# Avg. block
# short dimension
panel_58 = Panel(cluster.a1)

# ----
# between
panel_59 = Panel("151843410445")

# ----
# Single run of main cluster
# with predefined parameters
# Min Jv
# Max complexity
# Max Jv
toggle_2 = BooleanToggle(False)
panel_60 = Panel("661203447017")
panel_61 = Panel("275544073492")
panel_62 = Panel("770071205097")
num = Number(panel_59)
read_combination_py = GhPythonScript(trigger=toggle_2, identifier=num)  # -> out, a, b, c, d, e, f, g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; inputs trigger: Boolean
# ---------- read_combination_py: Python ----------
__author__ = "GEr"
__version__ = "2023.03.04"

if trigger is True:
    file_path = r'C:\Users\GEr\OneDrive - NGI\Research\Parametric_Rockmass_Studies\combinations\{}.txt'.format(identifier)

    f = open(file_path, 'r')
    content = f.read()
    content = content.split(')')[0]
    content = content.replace('(', '')
    content = content.replace(' ', '')
    content = content.replace('L', '')
    content = [eval(num) for num in content.split(',')]
    f.close()
    print(content)

    a, b, c, d, e, f, g, h, i, j, k, l, m, n, aa, ab, ac, ad, ae, af, ag, ah, ai, aj, ak, al, am, an = content
    if str(an) != identifier:
        raise ValueError('something wrong with input - output')
    else:
        pass
# ---------- end read_combination_py ----------
cluster_2 = Cluster(
    num=read_combination_py.a,
    num_3=read_combination_py.b,
    S=read_combination_py.c,
    n_discontinuities=read_combination_py.d,
    size_radius_2=read_combination_py.e,
    size_std=read_combination_py.f,
    dip_direction=read_combination_py.g,
    dipdir_std=read_combination_py.h,
    dip=read_combination_py.i,
    dip_std_2=read_combination_py.j,
    n_discontinuities_2=read_combination_py.k,
    size_radius_3=read_combination_py.l,
    size_std_3=read_combination_py.m,
    dip_direction_2=read_combination_py.n,
    dipdir_std_2=read_combination_py.aa,
    dip_2=read_combination_py.ab,
    dip_std_3=read_combination_py.ac,
    n_discontinuities_4=read_combination_py.ad,
    size_radius_4=read_combination_py.ae,
    size_std_4=read_combination_py.af,
    dip_direction_3=read_combination_py.ag,
    dipdir_std_3=read_combination_py.ah,
    dip_3=read_combination_py.ai,
    dip_std=read_combination_py.aj,
    n_discontinuities_3=read_combination_py.ak,
    size_radius=read_combination_py.al,
    size_std_2=read_combination_py.am,
    identifier=read_combination_py.an)  # -> spacing_set_1, spacing_set_2, spacing_set_3, rqd_y, rqd_x, rqd_z, apparent_spacing_y, apparent_spacing_x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; disabled

# ----
# between
panel_63 = Panel("834409102928")

# ==== cluster Cluster

# ----
# Overall bounding box
# Half bounding box size
num = ClusterInput()
# First level geometries
num_2 = Number(num)
expression = Expression(x=num_2, Expression="x/2")
rectangle = Rectangle(Plane=PlaneXY(0, 0, 0), XSize=num_2, YSize=num_2, Radius=0)  # -> Rectangle, Length
boxrec = BoxRectangle(Rectangle=rectangle.Rectangle, Height=num_2)

# ----
# Generation of X Y Z measurement lines
panel = Panel("0")
pt = ConstructPoint(XCoordinate=expression, YCoordinate=num_2, ZCoordinate=expression)
pt_2 = ConstructPoint(XCoordinate=expression, YCoordinate=expression, ZCoordinate=expression)
pt_3 = ConstructPoint(XCoordinate=expression, YCoordinate=panel, ZCoordinate=expression)
ln = Line(StartPoint=pt_3, EndPoint=pt)
rot3d = Rotate3D(Geometry=ln, Angle=1.570796327, Center=pt_2, Axis="{1,0,0}")  # -> Geometry, Transform
rot3d_2 = Rotate3D(Geometry=ln, Angle=1.570796327, Center=pt_2, Axis=Vector(0, 0, 1))  # -> Geometry, Transform

# ----
# Second level geometries
# Jv measurement boxes
num_3 = ClusterInput()
num_4 = Number(num_3)
dom = ConstructDomain(DomainStart=0, DomainEnd=num_4)
rectangle_2 = Rectangle(Plane=PlaneXY(0, 0, 0), XSize=dom, YSize=dom, Radius=0)  # -> Rectangle, Length
boxrec_2 = BoxRectangle(Rectangle=rectangle_2.Rectangle, Height=num_4)
arrbox = BoxArray(Geometry=boxrec_2, Cell=boxrec_2, XCount=num_2, YCount=num_2, ZCount=num_2)  # -> Geometry, Transform

# ----
# Generating Cross sections
# Plane normal to X
# Plane normal to Y
# Plane normal to Z
num_5 = Number(expression)
Z = UnitZ(Factor=num_5)
neg = Negative(Value=num_2)
vec = VectorXYZ(XComponent=num_5, YComponent=0, ZComponent=0)  # -> Vector, Length
vec_2 = VectorXYZ(XComponent=neg, YComponent=0, ZComponent=0)  # -> Vector, Length
move = Move(Geometry=ln, Motion=vec.Vector)  # -> Geometry, Transform
move_2 = Move(Geometry=[ln, rot3d_2.Geometry], Motion=Z)  # -> Geometry, Transform
Z_2 = UnitZ(Factor=neg)
extr = Extrude(Base=move_2.Geometry, Direction=Z_2)
item = ListItem(List=extr, Index=0, Wrap=True)
item_2 = ListItem(List=extr, Index=1, Wrap=True)
extr_2 = Extrude(Base=move.Geometry, Direction=vec_2.Vector)

# ----
# Discontinuities
# All Discontinuities
n_discontinuities = ClusterInput()
S = ClusterInput()
n_discontinuities_2 = ClusterInput()
dip_direction = ClusterInput()
size_radius = ClusterInput()
size_radius_2 = ClusterInput()
n_discontinuities_3 = ClusterInput()
dipdir_std = ClusterInput()
size_std = ClusterInput()
size_radius_3 = ClusterInput()
size_std_2 = ClusterInput()
dip_direction_2 = ClusterInput()
size_std_3 = ClusterInput()
n_discontinuities_4 = ClusterInput()
dip_std = ClusterInput()
dip_std_2 = ClusterInput()
size_radius_4 = ClusterInput()
dip_direction_3 = ClusterInput()
dip = ClusterInput()
dipdir_std_2 = ClusterInput()
dipdir_std_3 = ClusterInput()
dip_std_3 = ClusterInput()
size_std_4 = ClusterInput()
dip_2 = ClusterInput()
dip_3 = ClusterInput()

# ----
# Random seeds
# generation
random = Random(Range=Domain(0, 1), Number=100, Seed=S)
item_3 = ListItem(List=random, Index=0, Wrap=True)  # -> Item, Item1, Item2, Item3

discontinuity_set = DiscontinuitySet(
    R=boxrec,
    N=n_discontinuities_2,
    S=item_3.Item1,
    size_mean=size_radius_3,
    size_std=size_std_3,
    dipdir_mean=dip_direction_2,
    dipdir_std=dipdir_std_2,
    dip_mean=dip_2,
    dip_std=dip_std_3,
    random_set=Toggle(False))
discontinuity_set_2 = DiscontinuitySet(
    R=boxrec,
    N=n_discontinuities,
    S=item_3.Item,
    size_mean=size_radius_2,
    size_std=size_std,
    dipdir_mean=dip_direction,
    dipdir_std=dipdir_std,
    dip_mean=dip,
    dip_std=dip_std_2,
    random_set=Toggle(False))
discontinuity_set_3 = DiscontinuitySet(
    R=boxrec,
    N=n_discontinuities_4,
    S=item_3.Item2,
    size_mean=size_radius_4,
    size_std=size_std_4,
    dipdir_mean=dip_direction_3,
    dipdir_std=dipdir_std_3,
    dip_mean=dip_3,
    dip_std=dip_std,
    random_set=Toggle(False))
discontinuity_set_4 = DiscontinuitySet(R=boxrec, N=n_discontinuities_3, S=item_3.Item3, size_mean=size_radius, size_std=size_std_2, random_set=Toggle(True))
brep = Brep([discontinuity_set_2, discontinuity_set, discontinuity_set_3, discontinuity_set_4])

# ----
# Block generation
toggle = BooleanToggle(True)
python = GhPythonScript(trigger=toggle, surfaces=brep, boundary=boxrec, center_coords=expression)  # -> out, blocks, block_volumes, block_avg_edge_lenths, block_areas, n_blocks; inputs surfaces: list of Brep, boundary: Brep
# ---------- python: Python ----------
__author__ = "GEr"
__version__ = "2023.01.03"

import rhinoscriptsyntax as rs
from Rhino.Geometry import Brep, Point3d, VolumeMassProperties

if trigger is True:
    p = Point3d(center_coords, center_coords, center_coords)
    
    distances = []
    
    for surface in surfaces:
        p2 = surface.ClosestPoint(p)
        distances.append(p.DistanceTo(p2))
    
    # sort surfaces according to point distances
    surfaces_sorted = [s for _, s in sorted(zip(distances, surfaces))]
    print(len(surfaces_sorted))
    # create blocks from n innermost surfaces
    blocks_unfiltered = Brep.CreateSolid(surfaces_sorted[:300], 0.001)  # 0.01
    print(len(blocks_unfiltered))

    blocks_filtered = []
    block_volumes = []
    block_avg_edge_lenths = []
    block_areas = []
    for block in blocks_unfiltered:
        # compute properties of block
        vmp = VolumeMassProperties.Compute(block)
        # only consider blocks where the centroid is within the boundary
        if boundary.IsPointInside(vmp.Centroid, 0.01, strictlyIn=True) is True:
            # collect block
            blocks_filtered.append(block)
            # collect block volume
            vol = vmp.Volume
            if vol > 0:
                block_volumes.append(vol)
            # compute and collect block edge length
            edge_lengths = [edge.EdgeCurve.GetLength() for edge in block.Edges]
            block_avg_edge_lenths.append(sum(edge_lengths) / len(edge_lengths))
            # collect block surface area
            block_areas.append(block.GetArea())

    blocks = blocks_filtered
    n_blocks = len(blocks_filtered)
# ---------- end python ----------

# ----
# Find miminum bounding
# boxes for all blocks
# source:
# https://discourse.mcneel.com/t/minimum-oriented-bounding-box-implementation-in-grasshopper-python-script-node/64344/59
panel_2 = Panel("10")
minbb = MinimumBoundinbBox(G=python.blocks, N=panel_2)  # -> BB; inputs G: list of GeometryBase, N: Int32
# ---------- minbb: Python ----------
"""Combined 2D and 3D "fast" minimum bounding box calculator.
Accepts points, pointclouds, curves, surfaces, breps, extrusions, meshes.
Checks first for single object planarity or multi-object coplanarity.
User options for standard/fine sampling and intermediate result reporting
(3D BB only)

If planar/coplanar:
- Launches 2D planar bounding rectangle routine
- Finds a minimum bounding rectangle relative to a plane for a set of objects.
- Finds smallest area rectangle in plane first to 1 degree, then refines by 1/90
- continues looping with smaller increments until area no longer decreases. (tol)

If non planar/coplanar:
- Launches 3D bounding box routine
- Gets initial rough bounding box/plane: checks every 9 or 5 degrees in all 3 axes
- uses plane from previous check as start point for smaller refinements
- continues refnement stages until bounding box area no longer decreases. (tol)

Script by Mitch Heynick 23.06.18  Release version 1
Edit By willemderks 2019 01 16 to allow a single box for each selected object
Edit By dharman gersch 2019 04 11 to work in grasshopper python component.
    Inputs:
        G: list of geometry to get boundinb box
        N: number of samples. 10="Standard", 18="Fine"
        TODO: get bb for each branch to allow bounding boxes of groups of objects

    Output:
        BB: the resulting minimum volume oriented bounding box"""

__author__ = "Mitch Heynick"
__version__ = "2019.04.12"
__url__ = "https://discourse.mcneel.com/t/minimum-oriented-bounding-box-implementation-in-grasshopper-python-script-node/64344"

ghenv.Component.Name = "minimum Boundinb Box"
ghenv.Component.NickName = 'minbb'
ghenv.Component.Message = ''
ghenv.Component.Category = "Geo"
ghenv.Component.SubCategory = "1"

import rhinoscriptsyntax as rs
import scriptcontext as sc
import Rhino, math, time
import Rhino.DocObjects.ObjectType as OT

#get input objects plus settings
#TODO: add grasshopper inputs for command line options
def GetObjectsPlus3Boolean(prompt,b_prompts,b_opts,g_filt=None):
    go = Rhino.Input.Custom.GetObject()
    go.SetCommandPrompt(prompt)
    blnOption0=Rhino.Input.Custom.OptionToggle(*b_opts[0])
    blnOption1=Rhino.Input.Custom.OptionToggle(*b_opts[1])
    blnOption2=Rhino.Input.Custom.OptionToggle(*b_opts[2])
    go.AddOptionToggle(b_prompts[0],blnOption0)
    go.AddOptionToggle(b_prompts[1],blnOption1)
    go.AddOptionToggle(b_prompts[2],blnOption2)
    #allow preselected object
    go.EnablePreSelect(True,True)
    #main object type filter
    if g_filt: go.GeometryFilter=g_filt
    while True:
        get_rc = go.GetMultiple(1,0)
        if get_rc==Rhino.Input.GetResult.Cancel: return
        if get_rc==Rhino.Input.GetResult.Object:
            objs=go.Objects()
            break
        elif get_rc==Rhino.Input.GetResult.Option:
            continue
    a=blnOption0.CurrentValue
    b=blnOption1.CurrentValue
    c=blnOption2.CurrentValue
    return (objs,a,b,c)

#multi-object planarity/coplanarity check function
def CheckObjCoPlanarity(objs,tol=sc.doc.ModelAbsoluteTolerance):
    #accepts points, pointclouds, curves, surfaces, breps and meshes
    #try to "short-circuit" out if any curve or brep element is not planar
    pt_list=[]
    for obj in objs:
        if isinstance(obj,Rhino.Geometry.Point3d):
            pt_list.append(obj)
        elif isinstance(obj,Rhino.Geometry.Point):
            pt_list.append(obj.Location)
        elif isinstance(obj,Rhino.Geometry.PointCloud):
            pt_list.extend(obj.GetPoints())
        elif isinstance(obj,Rhino.Geometry.Curve):
            rc,plane=obj.TryGetPlane(tol)
            if not rc: return
            nc = obj.ToNurbsCurve()
            if nc is None: return
            crv_pts=[nc.Points[i].Location for i in xrange(nc.Points.Count)]
            pt_list.extend(crv_pts)
        elif isinstance(obj,Rhino.Geometry.Brep):
            for face in obj.Faces:
                rc,plane=face.TryGetPlane(tol)
                if not rc: return
                srf=face.ToNurbsSurface()
                if not srf: return
                for cp in srf.Points: pt_list.append(cp.Location)
        elif isinstance(obj,Rhino.Geometry.Surface):
            rc,plane=obj.TryGetPlane(tol)
            if not rc: return
            srf=obj.ToNurbsSurface()
            if not srf: return
            for cp in srf.Points: pt_list.append(cp.Location)
        elif isinstance(obj,Rhino.Geometry.Extrusion):
            rc,plane=obj.TryGetPlane(tol)
            if not rc: return
            srf=face.ToNurbsSurface()
            if not srf: return
            for cp in srf.Points: pt_list.append(cp.Location)
        elif isinstance(obj,Rhino.Geometry.Mesh):
            verts=obj.Vertices
            for vert in obj.Vertices: pt_list.append(Rhino.Geometry.Point3d(vert))
        else:
            return
    if Rhino.Geometry.Point3d.ArePointsCoplanar(pt_list,tol):
        rc, plane = Rhino.Geometry.Plane.FitPlaneToPoints(pt_list)
        if rc==Rhino.Geometry.PlaneFitResult.Success: return plane

#gets a plane-aligned bounding box
def BoundingBoxPlane(objs,plane,ret_pts=False,accurate=True):
    """returns a plane-aligned bounding box in world coordinates
       - input geometry must be RhinoCommon geometry (not IDs)
       - adapted from python rhinoscriptsyntax rs.BoundingBox() code."""
    wxy_plane=Rhino.Geometry.Plane.WorldXY
    def __objectbbox(geom,xform):
        if isinstance(geom,Rhino.Geometry.Point):
            pt=geom.Location
            if xform: pt = xform * pt
            return Rhino.Geometry.BoundingBox(pt,pt)
        if xform: return geom.GetBoundingBox(xform)
        return geom.GetBoundingBox(accurate)
    
    xform = Rhino.Geometry.Transform.ChangeBasis(wxy_plane, plane)
    bbox = Rhino.Geometry.BoundingBox.Empty
    if type(objs) is list or type(objs) is tuple:
        for obj in objs:
            objectbbox = __objectbbox(obj, xform)
            bbox = Rhino.Geometry.BoundingBox.Union(bbox,objectbbox)
    else:
        objectbbox = __objectbbox(objs, xform)
        bbox = Rhino.Geometry.BoundingBox.Union(bbox,objectbbox)
    if not bbox.IsValid: return
    plane_to_world = Rhino.Geometry.Transform.ChangeBasis(plane,wxy_plane)
    if ret_pts:
        corners = list(bbox.GetCorners())
        for pt in corners: pt.Transform(plane_to_world)
        return corners
    else:
        box=Rhino.Geometry.Box(bbox)
        box.Transform(plane_to_world)
        return box

#used in initial 3D bb calculation
def RotateCopyPlanes(tot_ang,count,init_planes,dir_vec):
    """takes a single plane or list of planes as input
    rotates/copies planes through angle tot_ang
    number of planes=count, number of angle divisions=count-1"""
    if isinstance(init_planes,Rhino.Geometry.Plane): init_planes=[init_planes]
    inc=tot_ang/(count-1)
    origin=Rhino.Geometry.Point3d(0,0,0)
    planes=[]
    objs=[]
    for i in range(count):
        for init_plane in init_planes:
            new_plane=Rhino.Geometry.Plane(init_plane)
            new_plane.Rotate(inc*i,dir_vec,origin)
            planes.append(new_plane)
    return planes

#used in initial 3D bb calculation
def GenerateOctantPlanes(count):
    tot_ang=math.pi*0.5 #90 degrees
    #generates an array of count^3 planes in 3 axes covering xyz positive octant
    yz_plane=Rhino.Geometry.Plane.WorldYZ
    dir_vec=Rhino.Geometry.Vector3d(1,0,0) #X axis
    x_planes=RotateCopyPlanes(tot_ang,count,yz_plane,dir_vec)
    dir_vec=Rhino.Geometry.Vector3d(0,-1,0) #-Y axis
    xy_planes=RotateCopyPlanes(tot_ang,count,x_planes,dir_vec)
    dir_vec=Rhino.Geometry.Vector3d(0,0,1) #Z axis
    xyz_planes=RotateCopyPlanes(tot_ang,count,xy_planes,dir_vec)
    return xyz_planes

#used in 3D refinement calculation
def RotatedPlaneArray(plane,tot_ang,divs,axis):
    """creates an array of planes rotated in increments around an axis
    tot_ang=total array inc. angle (rads); divided into divs number of divisions
    included angle is interval from -tot_ang/2 to +tot_ang/2
    number of output planes is divs; number of angle divisions is divs-1 """
    out_planes=[]
    plane.Rotate(-tot_ang*0.5,axis)
    out_planes.append(Rhino.Geometry.Plane(plane))
    inc=tot_ang/(divs-1)
    for i in range(divs-1):
        plane.Rotate(inc,axis)
        out_planes.append(Rhino.Geometry.Plane(plane))
    return out_planes

#used in 3D refinement calculation 
def RotatePlaneArray3D(view_plane,tot_ang,divs):
    #generate a 3D array of refinement planes (works with narrow angles)
    out_planes=[]
    #use RotatedPlaneArray to generate 'horizontal' left-right array (yaw)
    yaw_planes=RotatedPlaneArray(view_plane,tot_ang,divs,view_plane.ZAxis)
    for y_plane in yaw_planes:
        #use RotatedPlaneArray to generate side-to-side 'tilt' array (roll)
        roll_planes=RotatedPlaneArray(y_plane,tot_ang,divs,y_plane.YAxis)
        for r_plane in roll_planes:
            #use RotatedPlaneArray to generate up-down 'tilt' array (pitch)
            pitch_planes=RotatedPlaneArray(r_plane,tot_ang,divs,r_plane.XAxis)
            for p_plane in pitch_planes:
                out_planes.append(p_plane)
    return out_planes

#this is the main 3D bb calculation search function
def MinBBPlane(objs,best_plane,planes,curr_box,curr_vol):
    """returns plane with smallest aligned bounding box volume
    from list of input objects, planes to test and initial compare volume
    best plane, volume, and bbox pass through if no better solution found"""
    for plane in planes:
        bb=BoundingBoxPlane(objs,plane,ret_pts=False)
        if bb.Volume<curr_vol:
            curr_vol=bb.Volume
            best_plane=plane
            curr_box=bb
    return best_plane,curr_box,curr_vol

#3D (non-planar) bounding box routine
def Min3DBoundingBox(objs,init_plane,count,rel_stop,im_rep):
    #for non-planar or non-coplanar object(s)
    #get initial fast bb in init plane (World XY), plus volume to compare
    curr_bb=BoundingBoxPlane(objs,init_plane,False)
    curr_vol=curr_bb.Volume
    
    tot_ang=math.pi*0.5 #90 degrees for intial octant
    factor=0.1 #angle reduction factor for each successive refinement pass
    max_passes=20 #safety factor
    prec=Rhino.RhinoDoc.ActiveDoc.DistanceDisplayPrecision
    us=Rhino.RhinoDoc.ActiveDoc.GetUnitSystemName(True, False, False, False)
    
    #run intitial bb calculation
    xyz_planes=GenerateOctantPlanes(count)
    best_plane,curr_bb,curr_vol=MinBBPlane(objs,init_plane,xyz_planes,curr_bb,curr_vol)
    #report results of intial rough calculation
    if im_rep:
        print "Initial pass 0, volume: {} {}3".format(round(curr_vol,prec),us)
    #refine with smaller angles around best fit plane, loop until...
    for i in range(max_passes):
        prev_vol=curr_vol
        #reduce angle by factor, use refinement planes to generate array
        tot_ang*=factor
        ref_planes=RotatePlaneArray3D(best_plane,tot_ang,count)
        best_plane,curr_bb,curr_vol=MinBBPlane(objs,best_plane,ref_planes,curr_bb,curr_vol)
        vol_diff=prev_vol-curr_vol #vol. diff. over last pass, should be positive or 0
        #print "Volume difference from last pass: {}".format(vol_diff) #debug
        #check if difference is less than minimum "significant"
        #rel_stop==True: relative stop value <.01% difference from previous
        if rel_stop:
            if vol_diff<0.0001*prev_vol: break
        else:
            if vol_diff<sc.doc.ModelAbsoluteTolerance: break
        Rhino.RhinoApp.Wait()
        if im_rep:
            print "Refine pass {}, volume: {} {}3".format(i+1,round(curr_vol,prec),us)
        #get out of loop if escape is pressed
        if sc.escape_test(False):
            print "Refinement aborted after {} passes.".format(i+1)
            break
            
    return curr_bb,curr_vol,i+1

#this is the main 2D bb calculation search function
def PlanarMinBB(objs,plane,tot_ang,divs):
    inc=tot_ang/divs
    #rotate plane half total angle minus direction
    plane.Rotate(-tot_ang*0.5,plane.ZAxis,plane.Origin)
    bb = BoundingBoxPlane(objs,plane)
    curr_plane=Rhino.Geometry.Plane(plane)
    curr_area=BoxArea(bb)
    #loop through angle increments
    for i in range(divs):
        plane.Rotate(inc,plane.ZAxis,plane.Origin)
        bb = BoundingBoxPlane(objs,plane)
        new_area=BoxArea(bb)
        if new_area<curr_area:
            #print curr_area #debug
            #print new_area #debug
            curr_area=new_area
            curr_plane=Rhino.Geometry.Plane(plane)
    return curr_plane, curr_area

#2D planar bounding rectangle routine
def MinBoundingRectanglePlane(objs,curr_plane,im_rep=False):
    #pass True argument above if you want to print intermediate results
    #initialize
    factor=0.01 #0.01 (1/100 of model abs tolerance)
    angle=math.pi*0.5 #start angle 90 degrees
    divs=90  #initial division 1 degree intervals
    tol = sc.doc.ModelAbsoluteTolerance
    err_msg="Unable to calculate bounding box area"
    st=time.time()
    
    #get initial rough bounding box
    init_bb=BoundingBoxPlane(objs,curr_plane,ret_pts=False)
    curr_area=BoxArea(init_bb)
    if im_rep: print "Initial area: {}".format(curr_area)
    
    #main calculation loop
    safe=10 #set safety limit at 10
    for i in range(safe):
        curr_plane,new_area = PlanarMinBB(objs,curr_plane,angle,divs)
        #abort if area is 0 or extremely small
        if new_area<tol*0.1:
            print err_msg ; return
        #break out of loop if new area is the same as prev. area within limit
        if abs(curr_area-new_area)<factor*tol: break
        #otherwise, decrease increments and loop
        curr_area=new_area
        angle*=(1/divs)
        if im_rep:
            print "Refine stage {} Area: {}".format(i+1,curr_area)
            Rhino.RhinoApp.Wait() #wait for command line to print...
        if i==10: print "Max loop limit reached" #debug
        
    f_bb=BoundingBoxPlane(objs,curr_plane,ret_pts=True)
    return f_bb,curr_area,i

#used for planar bounding rectangle calculation
def BoxArea(box):
    return (box.X[1]-box.X[0])*(box.Y[1]-box.Y[0])


def CombinedMinBBMulti():
    #user input
    #get prev settings
    if "MinBBSample" in sc.sticky: u_samp = sc.sticky["MinBBSample"]
    else: u_samp = False #standard sampling
    if "MinBBStop" in sc.sticky: u_stop = sc.sticky["MinBBStop"]
    else: u_stop = True #relative volume stop value
    if "MinBBReports" in sc.sticky: u_rep = sc.sticky["MinBBReports"]
    else: u_rep = True #intermediate reports shown
    
    #prec=Rhino.RhinoDoc.ActiveDoc.DistanceDisplayPrecision
    prec = Rhino.RhinoDoc.ActiveDoc.DistanceDisplayPrecision
    #us=Rhino.RhinoDoc.ActiveDoc.GetUnitSystemName(True, False, False, False)
    us = Rhino.RhinoDoc.ActiveDoc.GetUnitSystemName(True, False, False, False)
    
    prompt="Select objects for minimum bounding box"
    gf=OT.Point|OT.PointSet|OT.Curve|OT.Surface|OT.Extrusion|OT.Brep|OT.Mesh
    bool_prompts=["Sampling","StopVal","ReportIntermedResults"]
    bool_ini=[[u_samp,"Standard","Fine"],[u_stop,"Absolute","Relative"],[u_rep,"No","Yes"]]
    #result=GetObjectsPlus3Boolean(prompt,bool_prompts,bool_ini,gf)
    inputs = G, False, False, False

    if inputs is None: return
    objIDs, fine_sample, rel_stop, im_rep= inputs
    

    #EDIT by willemderks to find bbox for each object individually
    
    bb = []
    
    for objID in objIDs:
        
        objs=[rs.coercegeometry(objID)]

        print "Checking object planarity/coplanarity..."
        st=time.time()
        plane=CheckObjCoPlanarity(objs,tol=sc.doc.ModelAbsoluteTolerance)
        
        if plane:
            if len(objs)==1: msg="Selected object is planar - "
            else: msg="All selected objects are coplanar - "
            msg+="launching 2D planar bounding rectangle calculation."
            print msg
            #launch planar bounding box routine
            f_bb,curr_area,passes=MinBoundingRectanglePlane(objs,plane,im_rep)
            #add polyline, report message
            #bbID=rs.AddPolyline([f_bb[0],f_bb[1],f_bb[2],f_bb[3],f_bb[0]])
            
            bb.append(Rhino.Geometry.Brep.CreateFromCornerPoints(f_bb[0],f_bb[1],f_bb[2],f_bb[3], 0.1))

            fa=round(curr_area,prec)
            msg="{} refinement stages. ".format(passes)
            msg+="Minimum bounding box area = {} sq. {}".format(fa,us)
            msg+=" Elapsed time: {:.2f} sec.".format(time.time()-st)
            
        else:
            #standard sample count=10 --> 1000 boxes per pass
            #fine sample count=18 --> 5832 boxes per pass
            if fine_sample: count=18
            else: count=10
            
            count = N
            wxy_plane=Rhino.Geometry.Plane.WorldXY
            if len(objs)==1: cp_msg="Selected object is not planar - "
            else: cp_msg="Selected objects are not coplanar - "
            cp_msg+="launching 3D bounding box calculation."
            print cp_msg
            #rs.Prompt("Calculating... please wait.")
            #launch 3D bounding box routine
            curr_bb,curr_vol,passes=Min3DBoundingBox(objs,wxy_plane,count,rel_stop,im_rep)
            
            #add box, report message
            if Rhino.RhinoApp.ExeVersion<6:
                #sc.doc.Objects.AddBrep(curr_bb.ToBrep()) #legacy
                bb.append(curr_bb.ToBrep())
            else:
                #sc.doc.Objects.AddBox(curr_bb)
                bb.append(curr_bb)
            fv=round(curr_vol,prec)
            msg="Final volume after {} passes is {} {}3".format(passes,fv,us)
            msg+=" | Elapsed time: {:.2f} sec.".format(time.time()-st)
            
        #final result reporting
        print msg
        #sc.doc.Views.Redraw()
    #save user settings
    #sc.sticky["MinBBSample"] = fine_sample
    #sc.sticky["MinBBReports"] = im_rep
    #sc.sticky["MinBBStop"] = rel_stop
    return bb


BB = CombinedMinBBMulti()
# ---------- end minbb ----------

# ----
# Measurement of apparent spacing
split = SplitWithBreps(Curve=rot3d_2.Geometry, Brep=brep)  # -> Curve, Points
split_2 = SplitWithBreps(Curve=rot3d.Geometry, Brep=brep)  # -> Curve, Points
split_3 = SplitWithBreps(Curve=ln, Brep=brep)  # -> Curve, Points
len = Length(Curve=split.Curve)
len_2 = Length(Curve=split_2.Curve)
len_3 = Length(Curve=split_3.Curve)
avr = Average(Input=len)
avr_2 = Average(Input=len_3)
avr_3 = Average(Input=len_2)

# ----
# Analyses
# Normal spacing measurement
spacing = Spacing(bounding_box=boxrec, mean_dip=dip, mean_dipdir=dip_direction, discontinuities=discontinuity_set_2)
spacing_2 = Spacing(bounding_box=boxrec, mean_dip=dip_2, mean_dipdir=dip_direction_2, discontinuities=discontinuity_set)
spacing_3 = Spacing(bounding_box=boxrec, mean_dip=dip_3, mean_dipdir=dip_direction_3, discontinuities=discontinuity_set_3)

# ----
# P32 measurement
# (area of fractures / unit volume)
# Compute Unit Volumes [m3]
customtrim_py = GhPythonScript(bounding_box=boxrec, discontinuities=brep)  # -> discontinuity_area, discontinuities_trimmed; inputs bounding_box: Brep, discontinuities: list of Brep
# ---------- customtrim_py: Python ----------
__author__ = "GEr"
__version__ = "2022.12.27"


discontinuities_trimmed = []
discontinuity_area = 0

for surface in discontinuities:
    trimmed_surface = surface.Trim(bounding_box, 0.001)

    if len(trimmed_surface) > 0:
        trimmed_surface = trimmed_surface[0]
    else:
        # also add fully enclosed surfaces
        trimmed_surface = surface

    discontinuity_area += trimmed_surface.GetArea()
    discontinuities_trimmed.append(trimmed_surface)
# ---------- end customtrim_py ----------
expression_2 = Expression(x=num_2, y=num_4, Expression="(x/y)³")
division = Division(A=customtrim_py.discontinuity_area, B=expression_2)

# ----
# Save discontinuity geometry
identifier = ClusterInput()
panel_3 = Panel("C:\Users\GEr\OneDrive - NGI\Research\Parametric_Rockmass_Studies\combinations")
python_2 = GhPythonScript(folder=panel_3, identifier=identifier, filetype="stl")  # -> out, filepath
# ---------- python_2: Python ----------
__author__ = "Schorsch"
__version__ = "2023.01.26"


filepath = r'{}\{}_discontinuities.{}'.format(folder, identifier, filetype)
# ---------- end python_2 ----------
mesh = MeshBrep(
    Brep=customtrim_py.discontinuities_trimmed,
    Settings={GridMaxCount=0, GridMinCount=16, JaggedSeams=False, MaxEdgeLength=0, MinEdgeLength=0.0001, MinTolerance=0, Refine=True, RefineAngle=0, RelativeTolerance=0.65, SimplePlanes=True, Tolerance=0})
mjoin = MeshJoin(Meshes=mesh)
pcexportstl = ExportSTL(
    Mesh=mjoin,
    Relocate=False,
    SavePath=python_2.filepath,
    SaveAsBinaryFile=True,
    SaveNow=Toggle(True),
    LastSaveLocalization="neutral,N")

# ----
# P20 & P21
p20_p21 = P20P21(srf=item_2, B=brep)  # -> R_2, R
p20_p21_2 = P20P21(srf=extr_2, B=brep)  # -> R_2, R
p20_p21_3 = P20P21(srf=item, B=brep)  # -> R_2, R

# ----
# Jv / P30 measurement
# (number of fractures / unit volume)
jv_py = GhPythonScript(Jv_boxes=arrbox.Geometry, discontinuities=brep)  # -> out, Jv; inputs Jv_boxes: list of Brep, discontinuities: list of Brep
# ---------- jv_py: Python ----------
__author__ = "GEr"
__version__ = "2022.12.30"

import ghpythonlib.parallel as ghp
from Rhino.Geometry import Intersect

def count_intersections(inputs):

    intersections = 0

    for box in Jv_boxes:
        for disc in discontinuities:
            intersection = Intersect.Intersection.BrepBrep(box, disc, 0.001)
            if len(intersection[1]) > 0:
                intersections += 1
    return intersections

inputs=['']

intersections = int(ghp.run(count_intersections, inputs)[0])

Jv = intersections / len(Jv_boxes)
# ---------- end jv_py ----------

# ----
# Block avg. edge length
avr_4 = Average(Input=python.block_avg_edge_lenths)

# ----
# Block surface area
avr_5 = Average(Input=python.block_areas)

# ----
# Block volumes
min_max = GhPythonScript(x=python.block_volumes)  # -> out, max, min; inputs x: list
# ---------- min_max: Python ----------
__author__ = "GEr"
__version__ = "2023.01.12"

if len(x) > 0:
    max_ = max(x)
    min_ = min(x)
# ---------- end min_max ----------
avr_6 = Average(Input=python.block_volumes)

# ----
# n blocks
num_6 = Number(python.n_blocks)

# ----
# compute average longest / shortest dimension of block
debox = DeconstructBox(Box=minbb)  # -> Plane, X, Y, Z
get_length = Get_length(I=debox.X)
get_length_2 = Get_length(I=debox.Y)
get_length_3 = Get_length(I=debox.Z)
python_3 = GhPythonScript(x_lengths=get_length, y_lengths=get_length_2, z_lengths=get_length_3)  # -> out, maxs, mids, mins; inputs x_lengths: list, y_lengths: list, z_lengths: list
# ---------- python_3: Python ----------
__author__ = "GEr"
__version__ = "2023.01.11"

mins = []
mids = []
maxs = []

for i in range(len(x_lengths)):
    subset = sorted([x_lengths[i], y_lengths[i], z_lengths[i]])
    print(subset)
    mins.append(subset[0])
    mids.append(subset[1])
    maxs.append(subset[2])
# ---------- end python_3 ----------
avr_7 = Average(Input=python_3.mids)
avr_8 = Average(Input=python_3.maxs)
avr_9 = Average(Input=python_3.mins)

# ----
# P10
p10 = P10(L=split_3.Points, C=ln)
p10_2 = P10(L=split_2.Points, C=rot3d.Geometry)
p10_3 = P10(L=split.Points, C=rot3d_2.Geometry)

# ----
# RQD
rqd = GhPythonScript(segments=len_3)  # -> out, RQD; inputs segments: list
# ---------- rqd: Python ----------
__author__ = "GEr"
__version__ = "2022.12.24"

if len(segments) == 0:  # in case there is no intersection
    RQD = 100
else:
    tot_length = sum(segments)
    pieces = [p for p in segments if p > 0.1]
    RQD = (sum(pieces) / tot_length) * 100
# ---------- end rqd ----------
rqd_2 = GhPythonScript(segments=len_2)  # -> out, RQD; inputs segments: list; same code as rqd
rqd_3 = GhPythonScript(segments=len)  # -> out, RQD; inputs segments: list; same code as rqd

apparent_spacing_x = ClusterOutput(avr)
apparent_spacing_z = ClusterOutput(avr_3)
spacing_set_1 = ClusterOutput(spacing)
spacing_set_2 = ClusterOutput(spacing_2)
apparent_spacing_y = ClusterOutput(avr_2)
# = P30
measured_jv = ClusterOutput(jv_py.Jv)
blocks_avg_edge_length = ClusterOutput(avr_4)
blocks_avg_volume = ClusterOutput(avr_6)
p10_y = ClusterOutput(p10)
blocks_min_volume = ClusterOutput(min_max.min)
blocks_avg_area = ClusterOutput(avr_5)
blocks_max_volume = ClusterOutput(min_max.max)
a1 = ClusterOutput(avr_9)
a3 = ClusterOutput(avr_8)
a2 = ClusterOutput(avr_7)
p10_x = ClusterOutput(p10_3)
blocks_n = ClusterOutput(num_6)
p20_x = ClusterOutput(p20_p21_3.R_2)
p21_x = ClusterOutput(p20_p21_3.R)
spacing_set_3 = ClusterOutput(spacing_3)
p10_z = ClusterOutput(p10_2)
p21_y = ClusterOutput(p20_p21.R)
p21_z = ClusterOutput(p20_p21_2.R)
p20_y = ClusterOutput(p20_p21.R_2)
p20_z = ClusterOutput(p20_p21_2.R_2)
p32 = ClusterOutput(division)
rqd_y = ClusterOutput(rqd.RQD)
rqd_x = ClusterOutput(rqd_3.RQD)
rqd_z = ClusterOutput(rqd_2.RQD)

# ----
# Colored visualization of discontinuities
geo = Geometry(customtrim_py.discontinuities_trimmed)  # disabled
vec_3 = Vector(geo)  # disabled
devec = DeconstructVector(Vector=vec_3)  # -> XComponent, YComponent, ZComponent; disabled
nvec2rgb = GhPythonScript(x=devec.XComponent, y=devec.YComponent, z=devec.ZComponent)  # -> out, R, G, B; inputs x: list, y: list, z: list; disabled
# ---------- nvec2rgb: Python ----------
__author__ = "GEr"
__version__ = "2023.02.24"

# make all vectors look into upper half sphere
x_new, y_new, z_new = [], [], []
for n_x, n_y, n_z in zip(x, y, z):
    if n_z < 0:
        x_new.append(n_x*-1)
        y_new.append(n_y*-1)
        z_new.append(n_z*-1)
    else:
        x_new.append(n_x)
        y_new.append(n_y)
        z_new.append(n_z)

R = [(c + 1)/2 for c in x_new]
G = [(c + 1)/2 for c in y_new]
B = [(c + 1)/2 for c in z_new]
# ---------- end nvec2rgb ----------
hsv = ColourHSV(Alpha=1, Hue=nvec2rgb.R, Saturation=nvec2rgb.G, Value=nvec2rgb.B)  # disabled
toggle_2 = BooleanToggle(False)  # disabled
createatts = CreateAttributes(Color=hsv, enableFullPath=False)  # disabled
bake = BakeGeometry(Bake=toggle_2, Geometry=geo, Attributes=createatts, DeleteOldBakes=False, PreserveTrees=False)  # disabled

# ==== cluster DiscontinuitySet
dipdir_mean = ClusterInput()
dipdir_std = ClusterInput()
size_mean = ClusterInput()
random_set = ClusterInput()
size_std = ClusterInput()
N = ClusterInput()
S = ClusterInput()
dip_mean = ClusterInput()
dip_std = ClusterInput()
R = ClusterInput()
pop3d = Populate3D(Region=R, Count=N, Seed=S)
distributions_py = GhPythonScript(
    count=N,
    size_mean=size_mean,
    size_std=size_std,
    dipdir_mean=dipdir_mean,
    dipdir_std=dipdir_std,
    dip_mean=dip_mean,
    dip_std=dip_std,
    random_set=random_set)  # -> out, sizes, dips, dipdirs; inputs count: Int32, random_set: Boolean
# ---------- distributions_py: Python ----------
__author__ = "GEr"
__version__ = "2023.02.03"

import math
import random


def normal(mean, std, size, only_positive=True):
    if only_positive is True:
        return [abs(random.gauss(mean, std)) for _ in range(size)]
    else:
        return [random.gauss(mean, std) for _ in range(size)]

sizes = normal(size_mean, size_std, count)

if random_set is True:
    dips = [math.radians(random.randint(0, 90)) for _ in range(count)]
    dipdirs = [math.radians(random.randint(0, 360)) for _ in range(count)]

else:
    dips = []
    for dip in normal(dip_mean, dip_std, count):
        if dip > 90:
            dips.append(math.radians(abs(90 - (dip - 90))))
        else:
            dips.append(math.radians(dip))

    dipdirs = []
    for dipdir in normal(dipdir_mean, dipdir_std, count, only_positive=False):
        print(dipdir)
        if dipdir > 360:
            dipdirs.append(math.radians(dipdir - 360))
        elif dipdir < 0:
            dipdirs.append(math.radians(360 + dipdir))
        else:
            dipdirs.append(math.radians(dipdir))
# ---------- end distributions_py ----------
polygon = Polygon(Plane=pop3d, Radius=distributions_py.sizes, Segments="12", FilletRadius=0)  # -> Polygon, Length
fpatch = FragmentPatch(Boundary=polygon.Polygon)
area = Area(Geometry=fpatch)  # -> Area, Centroid
# rotate dip
rot3d = Rotate3D(Geometry=fpatch, Angle=distributions_py.dips, Center=area.Centroid, Axis="{-1,0,0}")  # -> Geometry, Transform
# rotate dip dir
rot3d_2 = Rotate3D(Geometry=rot3d.Geometry, Angle=distributions_py.dipdirs, Center=area.Centroid, Axis="{0,0,-1}")  # -> Geometry, Transform
G = ClusterOutput(rot3d_2.Geometry)

# ==== cluster Spacing
bounding_box = ClusterInput()
mean_dipdir = ClusterInput()
mean_dip = ClusterInput()
discontinuities = ClusterInput()
geo = Geometry(discontinuities)
box = Box(bounding_box)

# ----
# get surface orientation of
# discontinuity set
dir2nvec = GhPythonScript(dip=mean_dip, dipdir=mean_dipdir)  # -> out, n_x, n_y, n_z
# ---------- dir2nvec: Python ----------
__author__ = "GEr"
__version__ = "2023.02.24"


from math import radians, sin, cos

n_x = sin(radians(dip)) * sin(radians(dipdir))
n_y = sin(radians(dip)) * cos(radians(dipdir))
n_z = cos(radians(dip))
# ---------- end dir2nvec ----------
vec = VectorXYZ(XComponent=dir2nvec.n_x, YComponent=dir2nvec.n_y, ZComponent=dir2nvec.n_z)  # -> Vector, Length

# ----
# center of box
volume = Volume(Geometry=box)  # -> Volume, Centroid

# ----
# create measurement line and trim to box
pdecon = Deconstruct(Point=volume.Centroid)  # -> XComponent, YComponent, ZComponent
multiplication = Multiplication(A=pdecon.XComponent, B="2")
multiplication_2 = Multiplication(A=vec.Vector, B=multiplication)
neg = Negative(Value=multiplication_2)
move = Move(Geometry=volume.Centroid, Motion=multiplication_2)  # -> Geometry, Transform
move_2 = Move(Geometry=volume.Centroid, Motion=neg)  # -> Geometry, Transform
ln = Line(StartPoint=move.Geometry, EndPoint=move_2.Geometry)
trim = TrimWithBrep(Curve=ln, Brep=box)  # -> Inside, Outside

# ----
# intersect with discontinuities
# and measure lengths of sections
split = SplitWithBreps(Curve=trim.Inside, Brep=geo)  # -> Curve, Points
len = Length(Curve=split.Curve)

avr = Average(Input=len)
am = ClusterOutput(avr)

# ==== cluster P10
L = ClusterInput()
C = ClusterInput()
lng = ListLength(List=L)
len = Length(Curve=C)
division = Division(A=lng, B=len)
R = ClusterOutput(division)

# ==== cluster P20P21
srf = ClusterInput()
srf_2 = Surface(srf)
B = ClusterInput()
bbx = BrepBrep(BrepA=srf_2, BrepB=B)  # -> flatten(Curves), Points
len = Length(Curve=bbx.Curves)
area = Area(Geometry=srf_2)  # -> Area, Centroid
lng = ListLength(List=bbx.Curves)
ma = MassAddition(Input=len)  # -> Result, PartialResults
division = Division(A=ma.Result, B=area.Area)
division_2 = Division(A=lng, B=area.Area)
R = ClusterOutput(division)
R_2 = ClusterOutput(division_2)

# ==== cluster Get_length
I = ClusterInput()
dedomain = DeconstructDomain(Domain=I)  # -> Start, End
subtraction = Subtraction(A=dedomain.End, B=dedomain.Start)
R = ClusterOutput(subtraction)
